# Grasshopper definition Rahmentuer_Schwelle.gh (Grasshopper 1.0.8)
# plug-ins: Pufferfish

getlichthoehe = GetInteger(AtLeast=1, AtMost=1, Maximum=2147483647, Minimum=-2147483648, Prompt="GetLichthoehe", TreeAccess=False)
getlichtbreite = GetInteger(AtLeast=1, AtMost=1, Maximum=2147483647, Minimum=-2147483648, Prompt="GetLichtbreite", TreeAccess=False)
get_point = GetPoint(AtLeast=1, AtMost=1, Prompt="GetPoint", Realtime=True, TreeAccess=False)
getbandseite = GetString(AtLeast=1, AtMost=1, Prompt="Bandseite", TreeAccess=False)
list = ValueList({"Links", "Rechts"}, selected="Links")
py3 = Python3Script()  # -> out, a; disabled
# ---------- py3: Python ----------
# Most robust version with explicit handling
x_str = str(x).lower().strip() if x else ""

# German variants
if x_str in ["links", "link"]:
    a = 0
# English variants  
elif x_str in ["rechts", "rechts"]:  # Note: "rechts" is German, but keeping for consistency
    a = 1
elif x_str in ["left", "l"]:
    a = 0
elif x_str in ["right", "r"]:
    a = 1
else:
    # Default to "links" if unknown
    a = 0
# ---------- end py3 ----------
xy = XYPlane(Origin=get_point)
deplane = DeconstructPlane(Plane=xy)  # -> Origin, XAxis, YAxis, ZAxis
pl = ConstructPlane(Origin=deplane.Origin, XAxis=deplane.XAxis, YAxis=deplane.ZAxis)
base_rahmenlichtmass_rechteck = Geometry(<curve referenced from the Rhino model>)
rectangle = Rectangle(Plane=pl, XSize=getlichtbreite, YSize=getlichthoehe, Radius=0)  # -> Rectangle, Length
debrep = DeconstructBrep(Brep=rectangle.Rectangle)  # -> Faces, Edges, Vertices
item = ListItem(List=debrep.Edges, Index=0, Wrap=True)  # -> Item, Item1
len = Length(Curve=item.Item1)
len_2 = Length(Curve=item.Item)
panel = Panel(len_2)
panel_2 = Panel(len)
item_2 = ListItem(List=debrep.Edges, Index=0, Wrap=True)  # -> Item, Item1
item_3 = ListItem(List=debrep.Vertices, Index=0, Wrap=True)
xz = XZPlane(Origin=item_3)
len_3 = Length(Curve=item_2.Item1)
len_4 = Length(Curve=item_2.Item)
xy_2 = XYPlane(Origin=Point(0, 0, 0))
einsprung_ins_licht = Slider(15, range=0..100)
deplane_2 = DeconstructPlane(Plane=xy_2)  # -> Origin, XAxis, YAxis, ZAxis

# ---- group: Mirror Plane Fries (YZ)
area = Area(Geometry=debrep.Faces)  # -> Area, Centroid
pl_2 = ConstructPlane(Origin=area.Centroid, XAxis=deplane_2.YAxis, YAxis=deplane_2.ZAxis)

# ----
expression = Expression(x=len_4, einsprung_ins_licht=einsprung_ins_licht, Expression="x-2*einsprung_ins_licht")
expression_2 = Expression(x=len_3, einsprung_ins_licht=einsprung_ins_licht, Expression="x-einsprung_ins_licht")
rev = Reverse(Vector=deplane_2.XAxis)
rev_2 = Reverse(Vector=deplane_2.YAxis)
rev_3 = Reverse(Vector=deplane_2.ZAxis)

geobasis_rahmenkanteln = Geometry(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)
brec = BoundingRectangle(Geometry=geobasis_rahmenkanteln, Plane=PlaneXY(0, 0, 0), Axis=0, Slide=0, Union=True)  # -> Bounding, DimensionX, DimensionY
debrep_2 = DeconstructBrep(Brep=brec.Bounding)  # -> Faces, Edges, Vertices

amp = Amplitude(Vector=deplane_2.XAxis, Amplitude=einsprung_ins_licht)
move = Move(Geometry=xz, Motion=amp)  # -> Geometry, Transform
rahmen_falzbreite = Slider(15, range=0..25)
rectangle_2 = Rectangle(Plane=move.Geometry, XSize=expression, YSize=expression_2, Radius=0)  # -> Rectangle, Length
debrep_3 = DeconstructBrep(Brep=rectangle_2.Rectangle)  # -> Faces, Edges, Vertices
item_4 = ListItem(List=debrep_3.Edges, Index=0, Wrap=True)  # -> Item, Item1
item_5 = ListItem(List=debrep_3.Vertices, Index=Slider(3, range=0..3), Wrap=True)
# Lichtmass Punkt_unten_links
item_6 = ListItem(List=debrep_3.Vertices, Index=Slider(0, range=0..3), Wrap=True)

# ---- group: Lichtmass_Türrahmen
join = JoinCurves(Curves=debrep_3.Edges, Preserve=False)

# ----
amp_2 = Amplitude(Vector=rev, Amplitude=rahmen_falzbreite)
len_5 = Length(Curve=item_4.Item)
len_6 = Length(Curve=item_4.Item1)
bodeneinstand = Slider(0, range=0..100)
schwelle = Slider(40, range=0..100)
# Rahmenfries Breite
panel_3 = Panel(brec.DimensionX)
# Rahmenfries Dicke
panel_4 = Panel(brec.DimensionY)
# Lichtmass Breite
panel_5 = Panel(len_5)
# Lichtmass Höhe
panel_6 = Panel(len_6)
move_2 = Move(Geometry=item_5, Motion=amp_2)  # -> Geometry, Transform
item_7 = ListItem(List=debrep_2.Vertices, Index=2, Wrap=True)
xy_3 = XYPlane(Origin=item_7)
xy_4 = XYPlane(Origin=item_6)
pl_3 = ConstructPlane(Origin=move_2.Geometry, XAxis=rev_3, YAxis=deplane_2.YAxis)

# ----
# Rahmen Extursion nach unten
addition = Addition(A=bodeneinstand, B=schwelle)

# ----
# Rahmen Extursion nach oben
expression_3 = Expression(lichtmass_h=panel_6, rahmenbreite=panel_3, Expression="lichtmass_h+rahmenbreite")

orient = Orient(Geometry=geobasis_rahmenkanteln, Source=xy_3, Target=xy_4)  # -> Geometry, Transform
orient_2 = Orient(Geometry=geobasis_rahmenkanteln, Source=xy_3, Target=pl_3)  # -> Geometry, Transform
rev_4 = Reverse(Vector=deplane_2.ZAxis)
boundary = BoundarySurfaces(Edges=orient.Geometry)
boundary_2 = BoundarySurfaces(Edges=orient_2.Geometry)
# Querfrieslänge
expression_4 = Expression(lichtmass_b=panel_5, falzbreite=rahmen_falzbreite, Expression="lichtmass_b+2*falzbreite")
amp_3 = Amplitude(Vector=rev_4, Amplitude=addition)
amp_4 = Amplitude(Vector=deplane_2.ZAxis, Amplitude=expression_3)
# Rahmenfries Länge
expression_5 = Expression(x=expression_3, y=addition, Expression="x+y")

extr = Extrude(Base=boundary, Direction=amp_3)
extr_2 = Extrude(Base=boundary, Direction=amp_4)
sunion = SolidUnion(Breps=[extr_2, extr])
mirror = Mirror(Geometry=sunion, Plane=pl_2)  # -> Geometry, Transform
merge = Merge(Data1=sunion, Data2=mirror.Geometry)
panel_7 = Panel(merge)

amp_5 = Amplitude(Vector=deplane_2.XAxis, Amplitude=expression_4)
# Frieslaenge_ab Schwelle
# Mit Bodeneinstand + Schwelle
mirror_2 = Mirror(Geometry=extr_2, Plane=pl_2)  # -> Geometry, Transform
extr_3 = Extrude(Base=boundary_2, Direction=amp_5)
sdiff = SolidDifference(BrepsA=extr_3, BrepsB=merge)

# ----
# Schwellen_konstruktion
bbox = BoundingBox(Content=extr_2, Plane=PlaneXY(0, 0, 0))  # -> Box, Box_2
debrep_4 = DeconstructBrep(Brep=bbox.Box)  # -> Faces, Edges, Vertices
# Frieslaenge_ab Schwelle
# Mit Bodeneinstand + Schwelle
number_slider = Slider(1, range=0..7)
item_8 = ListItem(List=debrep_4.Vertices, Index=number_slider, Wrap=True)
move_3 = Move(Geometry=item_8, Motion=amp_2)  # -> Geometry, Transform
mirror_3 = Mirror(Geometry=move_3.Geometry, Plane=pl_2)  # -> Geometry, Transform
dist = Distance(PointA=move_3.Geometry, PointB=mirror_3.Geometry)
panel_8 = Panel(dist)
amp_6 = Amplitude(Vector=deplane_2.XAxis, Amplitude=panel_8)

number_slider_2 = Slider(85, range=0..100)  # disabled
number_slider_3 = Slider(60, range=0..100)  # disabled
pl_4 = ConstructPlane(Origin=item_6, XAxis=rev, YAxis=rev_2)  # disabled
rectangle_3 = Rectangle(Plane=pl_4, XSize=number_slider_2, YSize=number_slider_3, Radius=0)  # -> Rectangle, Length; disabled
debrep_5 = DeconstructBrep(Brep=rectangle_3.Rectangle)  # -> Faces, Edges, Vertices; disabled
number_slider_4 = Slider(3, range=0..3)  # disabled
item_9 = ListItem(List=debrep_5.Vertices, Index=number_slider_4, Wrap=True)  # disabled

# ---- group: Schwellen Brett
# Schwellenbrett_l
bbox_2 = BoundingBox(Content=sunion, Plane=PlaneXY(0, 0, 0))  # -> Box, Box_2
debrep_6 = DeconstructBrep(Brep=bbox_2.Box)  # -> Faces, Edges, Vertices
item_10 = ListItem(List=debrep_6.Vertices, Index=0, Wrap=True)
schwellenbrett_h = Slider(80, range=30..200)
schwellenbrett_di = Slider(19, range=16..30)
mirror_4 = Mirror(Geometry=item_10, Plane=pl_2)  # -> Geometry, Transform
dist_2 = Distance(PointA=item_10, PointB=mirror_4.Geometry)
pl_5 = ConstructPlane(Origin=item_10, XAxis=deplane_2.YAxis, YAxis=rev_4)
panel_9 = Panel(dist_2)
rectangle_4 = Rectangle(Plane=pl_5, XSize=schwellenbrett_di, YSize=schwellenbrett_h, Radius=0)  # -> Rectangle, Length
boundary_3 = BoundarySurfaces(Edges=flatten(rectangle_4.Rectangle))
amp_7 = Amplitude(Vector=deplane_2.XAxis, Amplitude=panel_9)
extr_4 = Extrude(Base=boundary_3, Direction=amp_7)

# ----
schwellenrohr_di = Slider(2, range=2..4)
schwellen_b = Slider(20, range=20..60)
schwellen_h = Slider(40, range=20..60)
pl_6 = ConstructPlane(Origin=move_3.Geometry, XAxis=deplane_2.YAxis, YAxis=rev_4)
radii_1 = Integer(1)
expression_6 = Expression(x=schwellenrohr_di, y=radii_1, Expression="x+y")
rectangle_5 = Rectangle(Plane=pl_6, XSize=schwellen_b, YSize=schwellen_h, Radius=expression_6)  # -> Rectangle, Length
offcrv = OffsetCurve(Curve=rectangle_5.Rectangle, Plane=pl_6, Distance=expr("x*-1", schwellenrohr_di), BothSides=0, Kinks=0, CapType=1)
boundary_4 = BoundarySurfaces(Edges=flatten([rectangle_5.Rectangle, offcrv]))
extr_5 = Extrude(Base=boundary_4, Direction=amp_6)

tuerblatt_falzbreite = Slider(13, range=0..25)
rahmenfalztiefe = Slider(30, range=15..70)
luft_rh_zu_tb = Slider(5.5, range=5..6)
luft_oben = Slider(4, range=4..6)
luft_unten = Slider(4, range=4..6)
luft_seitlich = Slider(4, range=4..6)
tb_staerke = Slider(48, range=0..100)
amp_8 = Amplitude(Vector=deplane_2.XAxis, Amplitude=luft_seitlich)
expression_7 = Expression(x=rahmenfalztiefe, y=luft_rh_zu_tb, Expression="x-y")
move_4 = Move(Geometry=move_3.Geometry, Motion=amp_8)  # -> Geometry, Transform
amp_9 = Amplitude(Vector=deplane_2.YAxis, Amplitude=expression_7)

move_5 = Move(Geometry=move_4.Geometry, Motion=amp_9)  # -> Geometry, Transform
mirror_5 = Mirror(Geometry=move_5.Geometry, Plane=pl_2)  # -> Geometry, Transform
dist_3 = Distance(PointA=move_5.Geometry, PointB=mirror_5.Geometry)

# ----
# Lichtmass Höhe
# Lichtmass Höhe
expression_8 = Expression(lm_h=panel_6, lu_ob=luft_oben, lu_un=luft_unten, ra_falz_b=rahmen_falzbreite, Expression="lm_h-lu_ob-lu_un+ra_falz_b")
amp_10 = Amplitude(Vector=deplane_2.ZAxis, Amplitude=luft_unten)
move_6 = Move(Geometry=move_5.Geometry, Motion=amp_10)  # -> Geometry, Transform
deplane_3 = DeconstructPlane(Plane=xz)  # -> Origin, XAxis, YAxis, ZAxis
pl_7 = ConstructPlane(Origin=move_6.Geometry, XAxis=deplane_3.XAxis, YAxis=deplane_3.YAxis)
amp_11 = Amplitude(Vector=deplane_2.ZAxis, Amplitude=expression_8)
mirror_6 = Mirror(Geometry=move_6.Geometry, Plane=pl_2)  # -> Geometry, Transform
# Rahmenfalztiefe = Türblattfalztiefe
move_7 = Move(Geometry=mirror_6.Geometry, Motion=amp_11)  # -> Geometry, Transform
rec_2pt = Rectangle2Pt(Plane=pl_7, PointA=move_6.Geometry, PointB=move_7.Geometry, Radius=0)  # -> Rectangle, Length

# ----
# Rahmenfalz_innen
expression_9 = Expression(tb_falz=rahmenfalztiefe, tb_zu_ra_lu=luft_rh_zu_tb, Expression="tb_falz-tb_zu_ra_lu")
amp_12 = Amplitude(Vector=rev_2, Amplitude=expression_9)
move_8 = Move(Geometry=rec_2pt.Rectangle, Motion=amp_12)  # -> Geometry, Transform
debrep_7 = DeconstructBrep(Brep=move_8.Geometry)  # -> Faces, Edges, Vertices
paramplnonsrf = ParameterPlaneOnSurface(Surface=debrep_7.Faces, ParameterU=0.5, ParameterV=0.5)  # -> Plane, Normal
offcrv_2 = OffsetCurve(Curve=move_8.Geometry, Plane=paramplnonsrf.Plane, Distance=luft_seitlich, BothSides=0, Kinks=0, CapType=1)

boundary_5 = BoundarySurfaces(Edges=rec_2pt.Rectangle)
amp_13 = Amplitude(Vector=rev_2, Amplitude=rahmenfalztiefe)

# ----
# TB_innen
extr_6 = Extrude(Base=boundary_5, Direction=amp_13)

move_9 = Move(Geometry=rec_2pt.Rectangle, Motion=amp_13)  # -> Geometry, Transform
# TB_ueberschlag_mass
expression_10 = Expression(tb_st=tb_staerke, tb_falz=rahmenfalztiefe, Expression="tb_st-tb_falz")

# ---- group: Tuerblatt_dichtung
int8 = Integer(8)
offcrv_3 = OffsetCurve(Curve=move_9.Geometry, Plane=pl_7, Distance=expr("x*-1", int8), BothSides=0, Kinks=0, CapType=1)
int4 = Integer(4)
amp_14 = Amplitude(Vector=deplane_2.YAxis, Amplitude=int4)
boundary_6 = BoundarySurfaces(Edges=flatten([move_9.Geometry, offcrv_3]))
extr_7 = Extrude(Base=boundary_6, Direction=amp_14)

# ----
gethingefile = GetFilePath(AtLeast=1, AtMost=1, Prompt="GetHingeFile", TreeAccess=False)  # disabled
offcrv_4 = OffsetCurve(Curve=move_9.Geometry, Plane=pl_7, Distance=tuerblatt_falzbreite, BothSides=0, Kinks=0, CapType=1)
panel_10 = Panel(expression_10)
boundary_7 = BoundarySurfaces(Edges=flatten(offcrv_4))
amp_15 = Amplitude(Vector=rev_2, Amplitude=panel_10)
X = UnitX(Factor=1)
path = FilePath("C:\Users\adrian.muff\source\repos\rhinomcp\SFS_HE18EI30-M10X1X30-FIX.3dm")
amp_16 = Amplitude(Vector=deplane_2.YAxis, Amplitude=luft_rh_zu_tb)
block_definitions = QueryModelBlockDefinitions(Name="SFS_HE18EI30-M10X1X30-FIX", AutoUpdateState=True)
i_block = ImportModelBlockDefinition(FilePath=path, UpdateType=0)
extr_8 = Extrude(Base=boundary_7, Direction=amp_15)
band_versatzmass_sei = Slider(11, range=0..20)
# Band_konstruktion
move_10 = Move(Geometry=offcrv_4, Motion=amp_16)  # -> Geometry, Transform
sunion_2 = SolidUnion(Breps=flatten([extr_6, extr_8]))
block_instance = ModelBlockInstance(BlockDefinition=i_block)  # -> BlockInstance, Transform, BlockDefinition
xy_5 = XYPlane(Origin=Point(0, 0, 0))
debrep_8 = DeconstructBrep(Brep=move_10.Geometry)  # -> Faces, Edges, Vertices
band_tb_unten = Slider(1200, range=0..1600)
band_tb_mitte = Slider(440, range=0..1000)
band_tb_oben = Slider(240, range=0..1000)
S = Script(val_in=getbandseite)  # -> out, num_out, vec_out, lock_side_out, lock_side_switch
# ---------- S: Python ----------
"""Grasshopper Script"""
import Rhino.Geometry as rg

# Sicherstellen, dass val_in gültig ist
if val_in == "Links":
    num_out = 1
    vec_out = rg.Vector3d(-1, 0, 0)
    lock_side_out = "BL"
    lock_side_switch = False

elif val_in == "Rechts":
    num_out = 0
    vec_out = rg.Vector3d(1, 0, 0)
    lock_side_out = "BR"
    lock_side_switch = True

else:
    # Default-Fall, falls Eingabe ungültig ist
    num_out = 0
    vec_out = rg.Vector3d(0, 0, 0)
# ---------- end S ----------

move_11 = Move(Geometry=offcrv_4, Motion=amp_15)  # -> Geometry, Transform
debrep_9 = DeconstructBrep(Brep=move_11.Geometry)  # -> Faces, Edges, Vertices
debrep_10 = DeconstructBrep(Brep=rec_2pt.Rectangle)  # -> Faces, Edges, Vertices
item_11 = ListItem(List=debrep_10.Vertices, Index=S.num_out, Wrap=True)
item_12 = ListItem(List=debrep_9.Vertices, Index=S.num_out, Wrap=True)

S_2 = Script(val_in=getbandseite)  # -> out, num_out, vec_out
# ---------- S_2: Python ----------
"""Grasshopper Script"""
import Rhino.Geometry as rg

# Sicherstellen, dass val_in gültig ist
if val_in == "Links":
    num_out = 3
    vec_out = rg.Vector3d(-1, 0, 0)

elif val_in == "Rechts":
    num_out = 2
    vec_out = rg.Vector3d(1, 0, 0)

else:
    # Default-Fall, falls Eingabe ungültig ist
    num_out = 0
    vec_out = rg.Vector3d(0, 0, 0)
# ---------- end S_2 ----------
sdiff_2 = SolidDifference(BrepsA=sunion_2, BrepsB=flatten(extr_7))
amp_17 = Amplitude(Vector=S_2.vec_out, Amplitude=band_versatzmass_sei)
item_13 = ListItem(List=debrep_8.Vertices, Index=S_2.num_out, Wrap=True)
# Band_konstruktion_start
move_12 = Move(Geometry=item_13, Motion=amp_17)  # -> Geometry, Transform
amp_18 = Amplitude(Vector=S.vec_out, Amplitude=tuerblatt_falzbreite)
amp_19 = Amplitude(Vector=rev_3, Amplitude=band_tb_oben)
amp_20 = Amplitude(Vector=rev_3, Amplitude=band_tb_mitte)
amp_21 = Amplitude(Vector=rev_3, Amplitude=band_tb_unten)
move_13 = Move(Geometry=item_12, Motion=amp_18)  # -> Geometry, Transform
rev_5 = Reverse(Vector=S_2.vec_out)
move_14 = Move(Geometry=move_12.Geometry, Motion=amp_19)  # -> Geometry, Transform
pl_8 = ConstructPlane(Origin=move_14.Geometry, XAxis=rev_5, YAxis=deplane_2.YAxis)
move_15 = Move(Geometry=move_14.Geometry, Motion=amp_20)  # -> Geometry, Transform
pl_9 = ConstructPlane(Origin=move_15.Geometry, XAxis=rev_5, YAxis=deplane_2.YAxis)

# ---- group: TB_Stark
amp_22 = Amplitude(Vector=deplane_2.YAxis, Amplitude=tb_staerke)
move_16 = Move(Geometry=move_13.Geometry, Motion=amp_22)  # -> Geometry, Transform

# ----
move_17 = Move(Geometry=move_15.Geometry, Motion=amp_21)  # -> Geometry, Transform
pl_10 = ConstructPlane(Origin=move_17.Geometry, XAxis=rev_5, YAxis=deplane_2.YAxis)
orient_3 = Orient(Geometry=block_instance.BlockInstance, Source=xy_5, Target=[pl_8, pl_9, pl_10])  # -> Geometry, Transform

# ---- group: Bastel
expression_11 = Expression(x=luft_rh_zu_tb, y=panel_10, Expression="x+y")
amp_23 = Amplitude(Vector=deplane_2.YAxis, Amplitude=expression_11)
move_18 = Move(Geometry=move_13.Geometry, Motion=amp_23)  # -> Geometry, Transform

# ----
af_mass = Slider(19.5, range=0..100)
rev_6 = Reverse(Vector=deplane_2.YAxis)
amp_24 = Amplitude(Vector=rev_6, Amplitude=af_mass)
dm = Slider(70, range=0..100)
move_19 = Move(Geometry=move_16.Geometry, Motion=amp_24)  # -> Geometry, Transform
drh = Slider(1000, range=0..1000)
concat = Concatenate(FragmentA="Glutz Treplane 1834_", FragmentB=S.lock_side_out, FragmentC="_DM", FragmentD=dm)
path_2 = FilePath("C:\Users\adrian.muff\source\repos\rhinomcp\Glutz Treplane 1834 mit Schliessblech.3dm")
xy_6 = XYPlane(Origin=Point(0, 0, 0))
block_definitions_2 = QueryModelBlockDefinitions(Name=concat, AutoUpdateState=True)
i_block_2 = ImportModelBlockDefinition(FilePath=path_2, UpdateType=0)
deplane_4 = DeconstructPlane(Plane=xy_6)  # -> Origin, XAxis, YAxis, ZAxis
amp_25 = Amplitude(Vector=S.vec_out, Amplitude=dm)
amp_26 = Amplitude(Vector=deplane_2.ZAxis, Amplitude=drh)
block_instance_2 = ModelBlockInstance(BlockDefinition=i_block_2)  # -> BlockInstance, Transform, BlockDefinition
move_20 = Move(Geometry=move_19.Geometry, Motion=amp_26)  # -> Geometry, Transform
move_21 = Move(Geometry=move_13.Geometry, Motion=amp_25)  # -> Geometry, Transform
rev_7 = Reverse(Vector=S.vec_out)
path_3 = FilePath("C:\Users\adrian.muff\source\repos\rhinomcp\GLUTZ Topaz 5632C_5332C komplett RZ.3dm")
amp_27 = Amplitude(Vector=deplane_2.ZAxis, Amplitude=drh)
rev_8 = Reverse(Vector=S.vec_out)
block_definitions_3 = QueryModelBlockDefinitions(Name="GLUTZ Topaz 5632C_5332C komplett RZ", AutoUpdateState=True)
filter = StreamFilter(Gate=S.lock_side_switch, Stream0=rev_7, Stream1=S.vec_out)
Y = UnitY(Factor=1)
i_block_3 = ImportModelBlockDefinition(FilePath=path_3, UpdateType=0)
filter_2 = StreamFilter(Gate=S.lock_side_switch, Stream0=rev_8, Stream1=rev_8)
Y_2 = UnitY(Factor=1)

# ---- group: Lock_Switch
xy_7 = XYPlane(Origin=Point(0, 0, 0))
deplane_5 = DeconstructPlane(Plane=xy_7)  # -> Origin, XAxis, YAxis, ZAxis
pl_11 = ConstructPlane(Origin=deplane_5.Origin, XAxis=filter_2, YAxis=Y_2)

# ----
pl_12 = ConstructPlane(Origin=deplane_4.Origin, XAxis=filter, YAxis=Y)
block_instance_3 = ModelBlockInstance(BlockDefinition=i_block_3)  # -> BlockInstance, Transform, BlockDefinition
move_22 = Move(Geometry=move_21.Geometry, Motion=amp_27)  # -> Geometry, Transform
pl_13 = ConstructPlane(Origin=move_20.Geometry, XAxis=filter_2, YAxis=Y_2)

# ---- group: TB_Stark
amp_28 = Amplitude(Vector=deplane_2.YAxis, Amplitude=tb_staerke)
move_23 = Move(Geometry=move_22.Geometry, Motion=amp_28)  # -> Geometry, Transform

# ----
ln = Line(StartPoint=move_22.Geometry, EndPoint=move_23.Geometry)
orient_4 = Orient(Geometry=block_instance_2.BlockInstance, Source=pl_11, Target=pl_13)  # -> Geometry, Transform
midpt = CurveMiddle(Curve=ln)

# ---- group: Kickflip
pl_14 = ConstructPlane(Origin=move_22.Geometry, XAxis=S.vec_out, YAxis=deplane_2.ZAxis)
pl_15 = ConstructPlane(Origin=move_23.Geometry, XAxis=S.vec_out, YAxis=deplane_2.ZAxis)
filter_3 = StreamFilter(Gate=S.lock_side_switch, Stream0=pl_15, Stream1=pl_14)

# ----
xz_2 = XZPlane(Origin=midpt)
orient_5 = Orient(Geometry=block_instance_3.BlockInstance, Source=pl_12, Target=filter_3)  # -> Geometry, Transform
mirror_7 = Mirror(Geometry=orient_5.Geometry, Plane=xz_2)  # -> Geometry, Transform

geo = Geometry(sdiff)
geo_2 = Geometry(merge)
geo_3 = Geometry(extr_5)
geo_4 = Geometry(extr_4)
geo_5 = Geometry(orient_3.Geometry)
geo_6 = Geometry(sdiff_2)
geo_7 = Geometry(orient_4.Geometry)
geo_8 = Geometry([orient_5.Geometry, mirror_7.Geometry])

c_bake = ContextBake(Content=flatten([geo, geo_2, geo_3, geo_4, geo_5, geo_6, geo_7]))
