# Grasshopper definition Rahmentuer_UD3.gh (Grasshopper 1.0.8)
# plug-ins: Pufferfish, GhVa30, MetaHopper

get_plane = GetPlane(AtLeast=1, AtMost=1, Prompt="GetPlane", Realtime=True, TreeAccess=False)
wiredisplay = ControlWireDisplay(WireDisplay=2, AllObjects_Object=[rectangle, rahmenbreitel, rahmendicke, debrep, item, rectangle_3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])
deplane = DeconstructPlane(Plane=get_plane)  # -> Origin, XAxis, YAxis, ZAxis
revx = Reverse(Vector=deplane.XAxis)
revy = Reverse(Vector=deplane.YAxis)
lichtbreite = Slider(960, range=0..10000)
get_number_lichtbreite = GetNumber(AtLeast=1, AtMost=1, Maximum=1.797693135e+308, Minimum=-1.797693135e+308, Prompt="Lichtbreite", TreeAccess=False)
dichtnut_rahmen = BooleanToggle(True)
intumex_rahmen = BooleanToggle(True)
amp = Amplitude(Vector=deplane.XAxis, Amplitude=get_number_lichtbreite)
rahmenbreitel = Slider(120, range=80..250)
rahmendicke = Slider(53, range=40..70)
rahmenbreiter = Slider(100, range=80..250)
rectangle = Rectangle(Plane=get_plane, XSize=rahmenbreitel, YSize=rahmendicke, Radius=0)  # -> Rectangle, Length
geo = Geometry(<curve referenced from the Rhino model>)
line = Line(geo)
get_line = GetLine(AtLeast=1, AtMost=1, Prompt="Get_Line", Realtime=True, TreeAccess=False)  # disabled
sectsty = SectionStyle({RefHandle=92, RefName="Default"})
sectionopts = SectionOptions(Style=sectsty, Depth=10000, Text="AA'")
debrep = DeconstructBrep(Brep=rectangle.Rectangle)  # -> Faces, Edges, Vertices
section = Section(Curve=line, Options=sectionopts)
item = ListItem(List=debrep.Vertices, Index=1, Wrap=True)
move = Move(Geometry=item, Motion=amp)  # -> Geometry, Transform
pl = ConstructPlane(Origin=move.Geometry, XAxis=deplane.XAxis, YAxis=deplane.YAxis)
rectangle_2 = Rectangle(Plane=pl, XSize=rahmenbreiter, YSize=rahmendicke, Radius=0)  # -> Rectangle, Length
debrep_2 = DeconstructBrep(Brep=rectangle_2.Rectangle)  # -> Faces, Edges, Vertices
item_2 = ListItem(List=debrep_2.Vertices, Index=0, Wrap=True)
level = Level(Name="1", Elevation=0, CutPlane=1400, TopOffset=-350, BottomOffset=-50)
desectopts = DeconstructSectionOptions(Options=sectionopts)  # -> Style, Depth, Text
pl_2 = ConstructPlane(Origin=item_2, XAxis=deplane.XAxis, YAxis=deplane.YAxis)
building = Building(Name="Building", Elevation=0, Levels=level)
pl_3 = ConstructPlane(Origin=item, XAxis=revx, YAxis=deplane.YAxis)
sectviewsty = SectionViewStyle({RefHandle=210, RefName="Default"})
sectviewopts = SectionViewOptions(Style=sectviewsty, Title=desectopts.Text, Projection=True, Autoupdate=False)
geo_2 = Geometry(<point referenced from the Rhino model>)
xy = XYPlane(Origin=Point(0, 0, 0))

# ---- group: RahmenFalz
falz_b = Slider(15, range=0..100)
falz_t = Slider(38, range=0..100)
rectangle_3 = Rectangle(Plane=pl_3, XSize=falz_b, YSize=falz_t, Radius=0)  # -> Rectangle, Length
debrep_3 = DeconstructBrep(Brep=rectangle_3.Rectangle)  # -> Faces, Edges, Vertices

# ----
expression = Expression(x=falz_t, Expression="tuerstaerke-falztiefe-abstand_rahmen_falz-abstand_ausserkant_rahmen")
sectview = SectionView(Point=geo_2, Section=section, Options=sectviewopts)
geo_3 = Geometry(sectview)

rectangle_4 = Rectangle(Plane=pl_2, XSize=falz_b, YSize=falz_t, Radius=0)  # -> Rectangle, Length
debrep_4 = DeconstructBrep(Brep=rectangle_4.Rectangle)  # -> Faces, Edges, Vertices

# ---- group: Querfries
# Construct Plane for Top Frame
item_3 = ListItem(List=debrep_4.Vertices, Index=1, Wrap=True)
pl_4 = ConstructPlane(Origin=item_3, XAxis=deplane.ZAxis, YAxis=deplane.YAxis)

# ---- group: RahmenDichtNut
item_4 = ListItem(List=debrep_3.Vertices, Index=2, Wrap=True)
dichtnut_b = Slider(8, range=0..100)
dichtnut_t = Slider(4, range=0..100)
pl_5 = ConstructPlane(Origin=item_4, XAxis=revx, YAxis=revy)
rectangle_5 = Rectangle(Plane=pl_5, XSize=dichtnut_b, YSize=dichtnut_t, Radius=0)  # -> Rectangle, Length
filter = StreamFilter(Gate=dichtnut_rahmen, Stream1=rectangle_5.Rectangle)

# ---- group: Intumex_Rahmen
std_abstand_intumex = Slider(7, range=0..10)
amp_2 = Amplitude(Vector=revy, Amplitude=std_abstand_intumex)
intumex_t = Slider(2, range=0..100)
intumex_b = Slider(15, range=0..100)
move_2 = Move(Geometry=pl_5, Motion=amp_2)  # -> Geometry, Transform
rectangle_6 = Rectangle(Plane=move_2.Geometry, XSize=intumex_t, YSize=intumex_b, Radius=0)  # -> Rectangle, Length
filter_2 = StreamFilter(Gate=intumex_rahmen, Stream1=rectangle_6.Rectangle)

# ----
item_5 = ListItem(List=debrep_4.Vertices, Index=2, Wrap=True)
pl_6 = ConstructPlane(Origin=item_5, XAxis=deplane.XAxis, YAxis=revy)
rectangle_7 = Rectangle(Plane=pl_6, XSize=dichtnut_b, YSize=dichtnut_t, Radius=0)  # -> Rectangle, Length
filter_3 = StreamFilter(Gate=dichtnut_rahmen, Stream1=rectangle_7.Rectangle)

move_3 = Move(Geometry=pl_6, Motion=amp_2)  # -> Geometry, Transform
rectangle_8 = Rectangle(Plane=move_3.Geometry, XSize=intumex_t, YSize=intumex_b, Radius=0)  # -> Rectangle, Length
filter_4 = StreamFilter(Gate=intumex_rahmen, Stream1=rectangle_8.Rectangle)

runion = RegionUnion(Curves=flatten([rectangle_4.Rectangle, filter_3]))
runion_2 = RegionUnion(Curves=flatten([rectangle_3.Rectangle, filter]))
runion_3 = RegionUnion(Curves=flatten([runion, filter_4]))
runion_4 = RegionUnion(Curves=flatten([runion_2, filter_2]))
lichthoehe = Slider(423, range=0..2500)
get_number_lichthoehe = GetNumber(AtLeast=1, AtMost=1, Maximum=1.797693135e+308, Minimum=-1.797693135e+308, Prompt="Lichthoehe", TreeAccess=False)
rdiff = RegionDifference(CurvesA=rectangle_2.Rectangle, CurvesB=runion_3)
rdiff_2 = RegionDifference(CurvesA=rectangle.Rectangle, CurvesB=runion_4)
debrep_5 = DeconstructBrep(Brep=flatten([filter_2, filter_4]))  # -> Faces, Edges, Vertices
debrep_6 = DeconstructBrep(Brep=rdiff)  # -> Faces, Edges, Vertices
debrep_7 = DeconstructBrep(Brep=rdiff_2)  # -> Faces, Edges, Vertices
tuer_luft_rahmenfalz = Slider(5.5, range=0..10)
tuer_luft_seitlich = Slider(4, range=0..10)
tuer_luft_unten = Slider(6, range=0..10)
expression_2 = Expression(
    lichthoehe=get_number_lichthoehe,
    falz=falz_b,
    luft_seitlich=tuer_luft_seitlich,
    abstand_unten=tuer_luft_unten,
    Expression="lichthoehe+falz-luft_seitlich-abstand_unten")
tuerhoehe_falz = Panel(expression_2)
abstand_zu_ausserkant_rahmen = Slider(1, range=0..20)
tuerstaerke = Slider(58, range=0..100)
expression_3 = Expression(
    ts=tuerstaerke,
    ft=falz_t,
    ab_ra_f=tuer_luft_rahmenfalz,
    ab_ak_ra=abstand_zu_ausserkant_rahmen,
    Expression="ts-ft+ab_ra_f-ab_ak_ra")
layer = ModelLayer(
    Name="Tuerrahmen",
    DisplayColour=ColourSwatch(SwatchColor=RGB(138, 138, 138)),
    Material={ContentXML="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", Path="(Default Material)"})  # -> Layer, Name, Hidden, Locked, DisplayColour, Material, Linetype
layer_2 = ModelLayer(
    Name="Intumex_Rahmen",
    DisplayColour=ColourSwatch(SwatchColor=RGB(255, 0, 0)),
    Material={ContentXML="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", Path="(Default Material)"})  # -> Layer, Name, Hidden, Locked, DisplayColour, Material, Linetype
layer_3 = ModelLayer(
    Name="Tuerblatt",
    DisplayColour=ColourSwatch(SwatchColor=RGB(82, 82, 82)),
    Material={ContentXML="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", Path="(Default Material)"})  # -> Layer, Name, Hidden, Locked, DisplayColour, Material, Linetype

# ---- group: Querfries
rahmenbreiteo = Slider(80, range=80..250)
item_6 = ListItem(List=debrep_2.Vertices, Index=1, Wrap=True)
pl_7 = ConstructPlane(Origin=item_6, XAxis=deplane.XAxis, YAxis=deplane.YAxis)
rectangle_9 = Rectangle(Plane=pl_7, XSize=rahmenbreiteo, YSize=rahmendicke, Radius=0)  # -> Rectangle, Length
debrep_8 = DeconstructBrep(Brep=rectangle_9.Rectangle)  # -> Faces, Edges, Vertices
item_7 = ListItem(List=debrep_8.Vertices, Index=0, Wrap=True)
pl_8 = ConstructPlane(Origin=item_7, XAxis=deplane.XAxis, YAxis=deplane.YAxis)
amp_3 = Amplitude(Vector=deplane.ZAxis, Amplitude=get_number_lichthoehe)
expression_4 = Expression(x=falz_b, y=get_number_lichtbreite, Expression="2*x+y")
länge_querfries = Panel(expression_4)

rectangle_10 = Rectangle(Plane=pl_8, XSize=falz_b, YSize=falz_t, Radius=0)  # -> Rectangle, Length
debrep_9 = DeconstructBrep(Brep=rectangle_10.Rectangle)  # -> Faces, Edges, Vertices

# ----
addition = Addition(A=get_number_lichthoehe, B=rahmenbreiteo)
amp_4 = Amplitude(Vector=deplane.ZAxis, Amplitude=addition)
extr = Extrude(Base=debrep_5.Faces, Direction=amp_4)
extr_2 = Extrude(Base=debrep_6.Faces, Direction=amp_4)
extr_3 = Extrude(Base=debrep_7.Faces, Direction=amp_4)
expression_5 = Expression(x=länge_querfries, y=tuer_luft_seitlich, Expression="x-2*y")
tuerbreite_falz = Panel(expression_5)

item_8 = ListItem(List=debrep_3.Vertices, Index=2, Wrap=True)
xamp = Amplitude(Vector=deplane.XAxis, Amplitude=tuer_luft_seitlich)
move_4 = Move(Geometry=item_8, Motion=xamp)  # -> Geometry, Transform
yamp = Amplitude(Vector=revy, Amplitude=tuer_luft_rahmenfalz)
move_5 = Move(Geometry=move_4.Geometry, Motion=yamp)  # -> Geometry, Transform
pl_9 = ConstructPlane(Origin=move_5.Geometry, XAxis=deplane.XAxis, YAxis=revy)
zamp = Amplitude(Vector=deplane.ZAxis, Amplitude=tuer_luft_unten)
move_6 = Move(Geometry=pl_9, Motion=zamp)  # -> Geometry, Transform
rectangle_11 = Rectangle(Plane=move_6.Geometry, XSize=tuerbreite_falz, YSize=tuerstaerke, Radius=0)  # -> Rectangle, Length
zamp_2 = Amplitude(Vector=deplane.ZAxis, Amplitude=tuerhoehe_falz)
debrep_10 = DeconstructBrep(Brep=rectangle_11.Rectangle)  # -> Faces, Edges, Vertices
extr_4 = Extrude(Base=debrep_10.Faces, Direction=zamp_2)
ueberschlagbreite = Slider(15, range=10..50)
item_9 = ListItem(List=debrep_10.Vertices, Index=-1, Wrap=True)
pl_10 = ConstructPlane(Origin=item_9, XAxis=deplane.XAxis, YAxis=deplane.ZAxis)
pl_11 = ConstructPlane(Origin=item_9, XAxis=revx, YAxis=deplane.YAxis)
rectangle_12 = Rectangle(Plane=pl_10, XSize=tuerbreite_falz, YSize=tuerhoehe_falz, Radius=0)  # -> Rectangle, Length
rectangle_13 = Rectangle(Plane=pl_11, XSize=ueberschlagbreite, YSize=expression_3, Radius=0)  # -> Rectangle, Length
debrep_11 = DeconstructBrep(Brep=rectangle_12.Rectangle)  # -> Faces, Edges, Vertices
item_10 = ListItem(List=debrep_11.Edges, Index=[1, 2, 3], Wrap=True)
join = JoinCurves(Curves=item_10, Preserve=False)
c_script = CSharpScript(rail=join, shapes=rectangle_13.Rectangle)  # -> out, A; inputs rail: Curve, shapes: list of Curve, dir: Vector3d
# ---------- c_script: C# ----------
using System;
using System.Collections;
using System.Collections.Generic;

using Rhino;
using Rhino.Geometry;

using Grasshopper;
using Grasshopper.Kernel;
using Grasshopper.Kernel.Data;
using Grasshopper.Kernel.Types;

/// <summary>
/// This class will be instantiated on demand by the Script component.
/// </summary>
public class Script_Instance : GH_ScriptInstance
{
  /// <summary>Print a String to the [Out] Parameter of the Script component.</summary>
  /// <param name="text">String to print.</param>
  private void Print(string text) { /* Implementation hidden. */ }
  /// <summary>Print a formatted String to the [Out] Parameter of the Script component.</summary>
  /// <param name="format">String format.</param>
  /// <param name="args">Formatting parameters.</param>
  private void Print(string format, params object[] args) { /* Implementation hidden. */ }
  /// <summary>Print useful information about an object instance to the [Out] Parameter of the Script component. </summary>
  /// <param name="obj">Object instance to parse.</param>
  private void Reflect(object obj) { /* Implementation hidden. */ }
  /// <summary>Print the signatures of all the overloads of a specific method to the [Out] Parameter of the Script component. </summary>
  /// <param name="obj">Object instance to parse.</param>
  private void Reflect(object obj, string method_name) { /* Implementation hidden. */ }

  /// <summary>Gets the current Rhino document.</summary>
  private readonly RhinoDoc RhinoDocument;
  /// <summary>Gets the Grasshopper document that owns this script.</summary>
  private readonly GH_Document GrasshopperDocument;
  /// <summary>Gets the Grasshopper script component that owns this script.</summary>
  private readonly IGH_Component Component;
  /// <summary>
  /// Gets the current iteration count. The first call to RunScript() is associated with Iteration==0.
  /// Any subsequent call within the same solution will increment the Iteration count.
  /// </summary>
  private readonly int Iteration;

  /// <summary>
  /// This procedure contains the user code. Input parameters are provided as regular arguments,
  /// Output parameters as ref arguments. You don't have to assign output parameters,
  /// they will have a default value.
  /// </summary>
  private void RunScript(
		Curve rail,
		List<Curve> shapes,
		Vector3d dir,
		ref object A)
  {
    var sweep = new SweepOneRail();
    sweep.SetRoadlikeUpDirection(dir);
    sweep.MiterType = 1;
    sweep.GlobalShapeBlending = false;
    sweep.SweepTolerance = RhinoDocument.ModelAbsoluteTolerance;
    sweep.AngleToleranceRadians = RhinoDocument.ModelAngleToleranceRadians;
    A = sweep.PerformSweep(rail, shapes);
  }

  // <Custom additional code> 

  // </Custom additional code> 
}
# ---------- end c_script ----------
cap = CapHoles(Brep=c_script.A)

tuerbreite_falz_2 = Panel(expression_5)
sunion = SolidUnion(Breps=flatten([cap, extr_4]))
fmerge = MergeFaces(Brep=sunion)  # -> Breps, Before, After
object = ModelObject(Geometry=flatten(fmerge.Breps), Name="Tuerblatt", Layer=layer_3.Layer)  # -> Object, Geometry, Name, Layer, Visibility, Display, Drafting, Render
object_2 = ModelObject(Geometry=flatten(extr), Name="Intumex_Rahmen", Layer=layer_2.Layer)  # -> Object, Geometry, Name, Layer, Visibility, Display, Drafting, Render

# ---- group: Querfries (continued)
item_11 = ListItem(List=debrep_9.Vertices, Index=2, Wrap=True)
pl_12 = ConstructPlane(Origin=item_11, XAxis=deplane.XAxis, YAxis=revy)
rectangle_14 = Rectangle(Plane=pl_12, XSize=dichtnut_b, YSize=dichtnut_t, Radius=0)  # -> Rectangle, Length
filter_5 = StreamFilter(Gate=dichtnut_rahmen, Stream1=rectangle_14.Rectangle)
runion_5 = RegionUnion(Curves=flatten([rectangle_10.Rectangle, filter_5]))

move_7 = Move(Geometry=pl_12, Motion=amp_2)  # -> Geometry, Transform
rectangle_15 = Rectangle(Plane=move_7.Geometry, XSize=intumex_t, YSize=intumex_b, Radius=0)  # -> Rectangle, Length
filter_6 = StreamFilter(Gate=intumex_rahmen, Stream1=rectangle_15.Rectangle)

runion_6 = RegionUnion(Curves=flatten([runion_5, filter_6]))
rdiff_3 = RegionDifference(CurvesA=rectangle_9.Rectangle, CurvesB=runion_6)
orient = Orient(Geometry=rdiff_3, Source=pl_8, Target=pl_4)  # -> Geometry, Transform
move_8 = Move(Geometry=orient.Geometry, Motion=amp_3)  # -> Geometry, Transform
debrep_12 = DeconstructBrep(Brep=move_8.Geometry)  # -> Faces, Edges, Vertices
paramplnonsrf = ParameterPlaneOnSurface(Surface=debrep_12.Faces, ParameterU=0.5, ParameterV=0.5)  # -> Plane, Normal
amp_5 = Amplitude(Vector=paramplnonsrf.Normal, Amplitude=expression_4)
extr_5 = Extrude(Base=debrep_12.Faces, Direction=amp_5)

# ----
sdiff = SolidDifference(BrepsA=extr_5, BrepsB=flatten([extr_2, extr_3]))
object_3 = ModelObject(Geometry=flatten([extr_3, extr_2, sdiff]), Name="Tuerrahmen", Layer=layer.Layer)  # -> Object, Geometry, Name, Layer, Visibility, Display, Drafting, Render
c_bake = ContextBake(Content=[object.Object, object_3.Object, object_2.Object, section, sectview])
